# Grasshopper definition PARAMETRIC SHELF 3.gh (Grasshopper 1.0.8)

panel = Panel("OVERALL DIMENSIONS")
height = Slider(3, range=0..100)
thickness = Slider(0.5, range=0..1)
depth = Slider(3, range=0..10)
width = Slider(3, range=0..100)
number_slider = Slider(2, range=0..10)
xy_plane = XYPlane(Origin=Point(0, 0, 0))
xy_plane_2 = XYPlane(Origin=Point(0, 0, 0))
xy_plane_3 = XYPlane(Origin=Point(0, 0, 0))
subtraction = Subtraction(A=width, B=thickness)
number_slider_2 = Slider(2, range=0..10)
panel_2 = Panel("""DATO DIMENSIONS
---------------
THICKNESS / 2)""")
division = Division(A=thickness, B=number_slider)
dato_dimension = Panel(division)
multiplication = Multiplication(A=dato_dimension, B=Slider(2, range=0..10))
subtraction_2 = Subtraction(A=depth, B=multiplication)
gap = Slider(0.03125, range=0..0.1)
rectangle = Rectangle(Plane=xy_plane_3, XSize=thickness, YSize=depth, Radius=0)  # -> Rectangle, Length
rectangle_2 = Rectangle(Plane=xy_plane_2, XSize=dato_dimension, YSize=subtraction_2, Radius=0)  # -> Rectangle, Length
rectangle_3 = Rectangle(Plane=xy_plane, XSize=subtraction, YSize=depth, Radius=0)  # -> Rectangle, Length
rectangle_4 = Rectangle(Plane=xy_plane, XSize=division, YSize=depth, Radius=0)  # -> Rectangle, Length
rectangle_5 = Rectangle(Plane=xy_plane, XSize=division, YSize=division, Radius=0)  # -> Rectangle, Length
subtraction_3 = Subtraction(A=height, B=multiplication)
division_2 = Division(A=thickness, B=number_slider)
box_rectangle = BoxRectangle(Rectangle=rectangle.Rectangle, Height=height)
division_3 = Division(A=thickness, B=number_slider_2)
division_4 = Division(A=subtraction, B=number_slider_2)
division_5 = Division(A=depth, B=number_slider_2)
addition = Addition(A=dato_dimension, B=gap)
vector_xyz = VectorXYZ(XComponent=dato_dimension, YComponent=dato_dimension, ZComponent=subtraction_3)  # -> Vector, Length
box_rectangle_2 = BoxRectangle(Rectangle=rectangle_4.Rectangle, Height=division_2)
box_rectangle_3 = BoxRectangle(Rectangle=rectangle_3.Rectangle, Height=thickness)
vector_xyz_2 = VectorXYZ(XComponent=division_4, YComponent=division_5, ZComponent=division_3)  # -> Vector, Length
box_rectangle_4 = BoxRectangle(Rectangle=rectangle_5.Rectangle, Height=thickness)
box_rectangle_5 = BoxRectangle(Rectangle=rectangle_2.Rectangle, Height=addition)
vector_xyz_3 = VectorXYZ(XComponent=dato_dimension, YComponent=dato_dimension, ZComponent=dato_dimension)  # -> Vector, Length
subtraction_4 = Subtraction(A=depth, B=division)
move = Move(Geometry=box_rectangle_5, Motion=vector_xyz.Vector)  # -> Geometry, Transform
move_2 = Move(Geometry=box_rectangle_5, Motion=vector_xyz_3.Vector)  # -> Geometry, Transform
duplicate_content = DuplicateContent(Content=box_rectangle_4)
solid_difference = SolidDifference(BrepsA=box_rectangle_3, BrepsB=box_rectangle_2)
rotate_3d = Rotate3D(Geometry=box_rectangle_2, Angle=degrees(Slider(180, range=0..1000)), Center=vector_xyz_2.Vector, Axis=Vector(0, 0, 1))  # -> Geometry, Transform
solid_difference_2 = SolidDifference(BrepsA=box_rectangle, BrepsB=move_2.Geometry)
unit_y = UnitY(Factor=subtraction_4)
geometry = Geometry(duplicate_content)
solid_difference_3 = SolidDifference(BrepsA=solid_difference, BrepsB=rotate_3d.Geometry)
solid_difference_4 = SolidDifference(BrepsA=solid_difference_2, BrepsB=move.Geometry)
panel_3 = Panel("SIDE LEFT")
move_3 = Move(Geometry=geometry, Motion=unit_y)  # -> Geometry, Transform
subtraction_5 = Subtraction(A=subtraction, B=division)
addition_2 = Addition(A=subtraction, B=multiplication)
solid_difference_5 = SolidDifference(BrepsA=solid_difference_3, BrepsB=box_rectangle_4)
mirror = Mirror(Geometry=solid_difference_4, Plane=PlaneYZ(0, 0, 0))  # -> Geometry, Transform
unit_x = UnitX(Factor=addition_2)
unit_x_2 = UnitX(Factor=subtraction_5)
move_4 = Move(Geometry=mirror.Geometry, Motion=unit_x)  # -> Geometry, Transform
geometry_2 = Geometry(duplicate_content)
move_5 = Move(Geometry=move_3.Geometry, Motion=unit_x_2)  # -> Geometry, Transform
solid_difference_6 = SolidDifference(BrepsA=solid_difference_5, BrepsB=move_3.Geometry)
panel_4 = Panel("SIDE RIGHT")
geometry_3 = Geometry(move_4.Geometry)
move_6 = Move(Geometry=geometry_2, Motion=unit_x_2)  # -> Geometry, Transform
solid_difference_7 = SolidDifference(BrepsA=solid_difference_6, BrepsB=move_5.Geometry)
solid_difference_8 = SolidDifference(BrepsA=solid_difference_7, BrepsB=move_6.Geometry)
unit_x_3 = UnitX(Factor=division)
move_7 = Move(Geometry=solid_difference_8, Motion=unit_x_3)  # -> Geometry, Transform
xy_plane_4 = XYPlane(Origin=Point(0, 0, 0))
mirror_2 = Mirror(Geometry=move_7.Geometry, Plane=xy_plane_4)  # -> Geometry, Transform
panel_5 = Panel("BOTTOM")
geometry_4 = Geometry(move_7.Geometry)
unit_z = UnitZ(Factor=height)
panel_6 = Panel("TOP")
move_8 = Move(Geometry=mirror_2.Geometry, Motion=unit_z)  # -> Geometry, Transform
